# Grasshopper definition algorithm.gh (Grasshopper 1.0.4)

# ---- group: input
pd = Slider(68, range=65..70)
width = Slider(175, range=170..180)
lens = Geometry(<curve referenced from the Rhino model>)

# ----
highest_point = Point(Point(0, 70, 0))
crv_cp = CurveClosestPoint(Point=highest_point, Curve=lens)  # -> Point, Parameter, Distance

# ---- group: width
division = Division(A=width, B=2)
division_2 = Division(A=width, B=2)
_50 = Number(50)
_0 = Number(0)
division_3 = Division(A=width, B=-2)
_50_2 = Number(-50)
_0_2 = Number(0)
division_4 = Division(A=width, B=-2)
_50_3 = Number(50)
_0_3 = Number(0)
_50_4 = Number(-50)
_0_4 = Number(0)
pt = ConstructPoint(XCoordinate=division, YCoordinate=_50, ZCoordinate=_0)
pt_2 = ConstructPoint(XCoordinate=division_2, YCoordinate=_50_2, ZCoordinate=_0_2)
pt_3 = ConstructPoint(XCoordinate=division_3, YCoordinate=_50_3, ZCoordinate=_0_3)
pt_4 = ConstructPoint(XCoordinate=division_4, YCoordinate=_50_4, ZCoordinate=_0_4)
ln = Line(StartPoint=pt, EndPoint=pt_2)
ln_2 = Line(StartPoint=pt_3, EndPoint=pt_4)

# ---- group: create groove
lens_groove_point_1 = Geometry(crv_cp.Point)
number = Number(1)
number_2 = Number(-1)
Z = UnitZ(Factor=number)
Z_2 = UnitZ(Factor=number_2)
move = Move(Geometry=lens_groove_point_1, Motion=Z_2)  # -> Geometry, Transform
move_2 = Move(Geometry=lens_groove_point_1, Motion=Z)  # -> Geometry, Transform
number_3 = Number(-1)
number_4 = Number(-1)
Y = UnitY(Factor=number_4)
Y_2 = UnitY(Factor=number_3)
move_3 = Move(Geometry=move_2.Geometry, Motion=Y)  # -> Geometry, Transform
move_4 = Move(Geometry=move.Geometry, Motion=Y_2)  # -> Geometry, Transform
lens_groove_point_2 = Geometry(move_4.Geometry)
lens_groove_point_3 = Geometry(move_3.Geometry)
polyline = PolyLine(Vertices=[lens_groove_point_2, lens_groove_point_1, lens_groove_point_3], Closed=False)
Y_3 = UnitY(Factor=1)
move_5 = Move(Geometry=polyline, Motion=Y_3)  # -> Geometry, Transform
groove_line_for_lens = Geometry(move_5.Geometry)
extrcrv = ExtrudeAlong(Base=lens, Curve=groove_line_for_lens)
groove_surface = Geometry(extrcrv)

# ---- group: center lens
connect = ConnectCurves(Curves=lens, Continuity=2, Close=True, Bulge=1)
closed_lens = Geometry(connect)
area = Area(Geometry=closed_lens)  # -> Area, Centroid
centerpoint = Point(area.Centroid)
pdecon = Deconstruct(Point=centerpoint)  # -> XComponent, YComponent, ZComponent
number_5 = Number(-1)
number_6 = Number(-1)
multiplication = Multiplication(A=pdecon.YComponent, B=number_5)
multiplication_2 = Multiplication(A=number_6, B=pdecon.XComponent)
Y_4 = UnitY(Factor=multiplication)
X = UnitX(Factor=multiplication_2)
move_6 = Move(Geometry=groove_surface, Motion=X)  # -> Geometry, Transform
move_7 = Move(Geometry=move_6.Geometry, Motion=Y_4)  # -> Geometry, Transform
centered_groove_surface = Geometry(move_7.Geometry)

# ---- group: mirror
_2 = Number(2)
division_5 = Division(A=pd, B=_2)
X_2 = UnitX(Factor=division_5)
move_8 = Move(Geometry=centered_groove_surface, Motion=X_2)  # -> Geometry, Transform
mirror = Mirror(Geometry=move_8.Geometry, Plane=PlaneYZ(0, 0, 0))  # -> Geometry, Transform
right_lens = Geometry(move_8.Geometry)
left_lens = Geometry(mirror.Geometry)
